# Grasshopper definition ufgTest.gh (Grasshopper 0.9.76)
# plug-ins: FloorPlanAutomation

crv = Curve(<curve referenced from the Rhino model>)
crv_2 = Curve(<curve referenced from the Rhino model>)
crv_3 = Curve(<curve referenced from the Rhino model>)
crv_4 = Curve(<curve referenced from the Rhino model>)
crv_5 = Curve(<curve referenced from the Rhino model>)
crv_6 = Curve(<curve referenced from the Rhino model>)
parcel_gen_2 = ParcelsFromInternalPoly(InputSiteCurve=crv_5, InternalPolyine=crv_4)  # disabled
path = FilePath("C:\nir_dev\MegaSavageLevel\DOTS\DotsProj\DotsProj\SourceCode\CBSP\sample_inputs\adj_inputs.csv")
path_2 = FilePath("C:\nir_dev\MegaSavageLevel\DOTS\DotsProj\DotsProj\SourceCode\CBSP\sample_inputs\geom_inputs.csv")
crv_7 = Curve(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)
crv_8 = Curve(<curve referenced from the Rhino model>)
parcel_gen_1a = ParcelsBySubdivision(
    InputSite=crv,
    NumOfParcels=Slider(7.52, range=0..20),
    DevMean01=Slider(0, range=0..1),
    AngleAlignmentDegrees0360=Slider(0, range=0..360),
    ShowThisIterations=Slider(20, range=0..20),
    ResetAllValues=Toggle(True))  # -> LowestDeviationSolution, OutputFromRequiredIteration; disabled
parcel_gen_1b = ParcelsBySubdivisionWithSubtraction(
    InputSite=crv_2,
    InternalCrv=crv_3,
    NumOfParcels=Slider(10.88, range=0..20),
    DevMean01=Slider(0, range=0..1),
    AngleAlignmentDegrees0360=Slider(55.296, range=0..360),
    ShowThisIterations=Slider(20, range=0..20),
    ResetAllValues=Toggle(True))  # -> LowestDeviationSolution, OutputFromRequiredIteration; disabled
crv_9 = Curve(<curve referenced from the Rhino model>)
input_cbsp = Cbsp(InputSiteGeometry=crv_7, FilePathAdjacency=path, FilePathGeometry=path_2)  # -> OutputAdjacency, OutputFunctions, TempGeomObjList, DisplayPolyline, RndVals, RecursivePolys, DebugString
crv_10 = Curve(<curve referenced from the Rhino model>)
stagerred_courtyard = StagerredCourtyardDotsComponent(
    Site=crv_6,
    Setback=Slider(6.24, range=0..20),
    OFFSET_INP=Slider(20, range=0..20),
    NumberOfDivisionsPerSegPolyOverallSmoothCurves=Slider(15, range=0..15),
    NumberOfTowers=Slider(15, range=0..20),
    FloorFloorHeight=Slider(3.213, range=0..20),
    BaseFSRFAR=Slider(2.389, range=0..20),
    TowerFSRFAR=Slider(0.84, range=0..20),
    MinimumAreaCrv=Slider(0, range=0..2000),
    MinimumAreaTowerCrv=Slider(257.1, range=0..2000))  # -> OffsetCurve, BaseFloorCurves, TowerFloorCurves, PolyFromSubDivOfCrvs, Debug, FinalBoundaryRepresentation; disabled
stagerred_mass = StagerredMassing(
    SiteCurve=crv_8,
    FloorHeightRequired=Slider(3.023, range=0..20),
    SetbackStepbacksForMassing="10,20,30,45",
    HeightsCorrespondingToStepbacks="10,20,30,45",
    MinArea=Slider(0, range=0..20000))  # -> OutputFloorCurves, OutputMassingBreps, OutputTextPanelTotalFSRGFAAchieved, DebugText; disabled
courtyard_mass = CourtyardMassing(
    SiteCurve=crv_9,
    FSRFAR=Slider(3.023, range=0..20),
    FloorHeight=Slider(6.223, range=0..20),
    Setback=Slider(20, range=0..20),
    BayDepth=Slider(20, range=0..20),
    MaxHtFloorArea=Slider(0, range=0..20000))  # -> OutputFloorCurves, OutputMassingBreps; disabled
block = ExtrudeBlock(
    SiteCurve=crv_10,
    Setback=Slider(14.714, range=0..20),
    FsrFar=Slider(11.857, range=0..20),
    FLRHT=Slider(3.183, range=0..20),
    MinCrvArea=Slider(0, range=0..20000),
    HtArea1Flr=Slider(0, range=0..1))  # -> OutputExtrudedMass, FloorCurves; disabled
panel = Panel(input_cbsp.OutputFunctions)
panel_2 = Panel(input_cbsp.TempGeomObjList)
geo = Geometry(stagerred_courtyard.TowerFloorCurves)
geo_2 = Geometry()
geo_3 = Geometry()
geo_4 = Geometry(block.FloorCurves)
